# Grasshopper definition Rhinoceros.gh (Grasshopper 1.0.7)
# plug-ins: Kangaroo2 Components, CORE.Toolbox.Grasshopper

# 1. Select the model to be populated with spheres (.stl)
import_3dm = Import3DM(
    File="D:\MANO\Doktoranturos_darbas\Experimentai\CSG_measures\Marble_arch_git\Model_creation\Wraper_modifi_scaled_down.stl",
    Layer="*",
    Name="*")
# A number of spheres to populate surface
panel = Panel("330")
# Factor used for model scale control
number_slider = Slider(0.9, range=0..2)
area_moments = AreaMoments(Geometry=import_3dm)  # -> Area, Centroid, Inertia, Secondary, Gyration
# Select sphere radius
number_slider_2 = Slider(2.5, range=0..5)
scale = Scale(Geometry=import_3dm, Center=area_moments.Centroid, Factor=number_slider)  # -> Geometry, Transform
mesh = Mesh(scale.Geometry)
populate_geometry = PopulateGeometry(Geometry=mesh, Count=panel, Seed=1)
construct_domain = ConstructDomain(DomainStart=number_slider_2, DomainEnd=number_slider_2)
list_length = ListLength(List=populate_geometry)
random = Random(Range=construct_domain, Number=list_length, Seed=2)
number = Number(random)
collider = Collider(Objects=populate_geometry, Radii=number, Strength=Slider(1, range=0..2))
spheremeshcollide = CSharpScript(
    M=mesh,
    Pts=populate_geometry,
    Radii=number,
    Strength=Slider(1.2, range=0..15),
    Reference="C:\Program Files MANO\Rhino 7\Plug-ins\Grasshopper\Components\KangarooSolver.dll")  # -> out, A; inputs M: Mesh, Pts: list of Point3d, Radii: list of Double, Strength: Double
# ---------- spheremeshcollide: C# usings ----------
using System.IO;
using System.Linq;
using System.Data;
using System.Drawing;
using System.Reflection;
using System.Windows.Forms;
using System.Xml;
using System.Xml.Linq;
using System.Runtime.InteropServices;

using Rhino.DocObjects;
using Rhino.Collections;
using GH_IO;
using GH_IO.Serialization;
using KangarooSolver;
using KangarooSolver.Goals;
///
///
///This script was written by Daniel Piker.
///
///
# ---------- spheremeshcollide: C# ----------
    A = new SphereMeshCollide(M, Pts, Radii, Strength);
# ---------- spheremeshcollide: C# additional code ----------
  public class SphereMeshCollide : GoalObject
  {
    Mesh M;
    List<double> Radii;
    double Strength;


    public SphereMeshCollide(Mesh M, List<Point3d> Pts, List<double> Radii, double Strength)
    {
      int ptCount = Pts.Count;
      PPos = Pts.ToArray();
      Move = new Vector3d[ptCount];
      Weighting = new double[ptCount];

      this.M = M;
      this.Radii = Radii;
      this.Strength = Strength;

    }

    public override void Calculate(List<KangarooSolver.Particle> p)
    {
      Point3d[] pts = this.GetCurrentPositions(p);

      for(int i = 0;i < pts.Length;i++)
      {
        bool inside = M.IsPointInside(pts[i], 0.1, true); 
        Point3d closest = M.ClosestPoint(pts[i]);
        Vector3d v = pts[i] - closest;
        double len = v.Length;

        if(!inside)
        {
          Move[i] = -1.5 * v;
          Weighting[i] = Strength;
        }
        else if(len < Radii[i])
        {
          double diff = Radii[i] - len;
          v.Unitize();
          Move[i] = v * diff;
          Weighting[i] = Strength;
        }
        else
        {
          Move[i] = Vector3d.Zero;
          Weighting[i] = 0;
        }
      }

    }
  }

  /// <summary>
  /// This method will be called once every solution, before any calls to RunScript.
  /// </summary>
  public override void BeforeRunScript()
  { }
  /// <summary>
  /// This method will be called once every solution, after any calls to RunScript.
  /// </summary>
  public override void AfterRunScript()
  { }
# ---------- end spheremeshcollide ----------
# 3. Turn on/off solver.
# Visualy inspect sphere distribution.
boolean_toggle = BooleanToggle(False)
# 4. Save the sphere center in an .xlsx file
button = Button()
solver = Solver(GoalObjects=[collider, spheremeshcollide.A], Reset=Button(), Threshold=1e-15, Tolerance=0.01, On=boolean_toggle)  # -> I, V, O
excel_settings = ExcelSettings(ClearValues=button, ClearFormatting=button, Save=False, Close=False)
# 2. Create a blank .xlsx file and set its path
partition_list = PartitionList(List=solver.V, Size=Slider(1, range=0..1))
U = UCount(10)
simplify_tree = SimplifyTree(Tree=partition_list, Front=False)
file_path = FilePath("D:\MANO\Doktoranturos_darbas\Experimentai\CSG_measures\Marble_arch_git\Model_creation\Rhino_spheres.xlsx")
addition = Addition(A=U, B=U)
mesh_sphere = MeshSphere(Base=solver.V, Radius=Slider(2.5, range=0..10), UCount=U, VCount=addition)
write_to_excel_classic = WriteToExcelClassic(
    WorkbookFilepath=file_path,
    Data=simplify_tree,
    LocationAddress="A1",
    Settings=excel_settings,
    Clear=button,
    Stream=button)
custom_preview = CustomPreview(
    Geometry=mesh_sphere,
    Material={diffuse=RGB(221, 160, 221), emission=RGB(66, 48, 66), shine=0.5, specular=RGB(255, 255, 255), transparency=0})
